# Grasshopper definition parametricPolygonLoft.gh (Grasshopper 1.0.7)

knob = ControlKnob(Decimals=0, Limit=True, Maximum=10, Minimum=0, Range=20, Value=8)
series = Series(Start=knob, Step=1, Count=10)
knob_2 = ControlKnob(Decimals=0, Limit=True, Maximum=10, Minimum=0, Range=10, Value=10)
series_2 = Series(Start=Slider(3, range=0..10), Step=1, Count=knob_2)
series_3 = Series(Start=Slider(2, range=0..10), Step=Slider(4, range=0..10), Count=10)
panel = Panel(series_2)
pt = ConstructPoint(XCoordinate=series_3, YCoordinate=Slider(3, range=0..10), ZCoordinate=series_3)
polygon = Polygon(Plane=pt, Radius=series, Segments=series_2, FilletRadius=0)  # -> Polygon, Length
move = Move(Geometry=polygon.Polygon, Motion=pt)  # -> Geometry, Transform
loft = Loft(Curves=move.Geometry, Options={Adjust=False, Closed=False, LoftEnds=0, LoftSimp=0, LoftType=0, Rebuild=10, Refit=0.01})
