# Grasshopper definition XZ Curve to series of Cylinders.gh (Grasshopper 1.0.7)

crv = Curve(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)
number_slider = Slider(1, range=0..1)
cluster = Cluster(C=crv, D=Slider(0.03, range=0..1))  # -> pt_2, Z
cyl = Cylinder(Base=cluster.pt_2, Radius=Slider(0.01, range=0.01..10), Length=cluster.Z)

# ==== cluster Cluster
C = ClusterInput()
D = ClusterInput()
contour = Contour(Curve=C, Point=Point(0, 0, 0), Direction=Vector(0, 0, 1), Distance=D)  # -> Contours, Parameters
panel = Panel(contour.Contours)
pdecon = Deconstruct(Point=panel)  # -> XComponent, YComponent, ZComponent
pdecon_2 = Deconstruct(Point=panel)  # -> XComponent, YComponent, ZComponent
Z = ClusterOutput(pdecon_2.ZComponent)
num = Number(0)
pt = ConstructPoint(XCoordinate=pdecon.XComponent, YCoordinate=pdecon.YComponent, ZCoordinate=num)
pt_2 = ClusterOutput(pt)
