# Grasshopper definition circletopointToLineToPipe.gh (Grasshopper 1.0.7)

pl_offset = PlaneOffset(BasePlane=PlaneXY(0, 0, 0), Offset=Slider(8, range=1..10))
pl_offset_2 = PlaneOffset(BasePlane=PlaneXY(0, 0, 0), Offset=Slider(4, range=1..10))
pl_offset_3 = PlaneOffset(BasePlane=PlaneXY(0, 0, 0), Offset=Slider(6, range=1..10))
pl_offset_4 = PlaneOffset(BasePlane=PlaneXY(0, 0, 0), Offset=Slider(1, range=1..10))
cir = Circle(Plane=pl_offset_2, Radius=Slider(5, range=1..10))
cir_2 = Circle(Plane=pl_offset_3, Radius=Slider(5, range=1..10))
# A parametric Diagram
# Change The radius
cir_3 = Circle(Plane=pl_offset_4, Radius=Slider(5, range=1..10))
cir_4 = Circle(Plane=pl_offset, Radius=Slider(5, range=1..10))
divide = DivideCurve(Curve=cir, Count=Slider(10, range=1..10), Kinks=False)  # -> Points, Tangents, Parameters
divide_2 = DivideCurve(Curve=cir_2, Count=Slider(10, range=1..10), Kinks=False)  # -> Points, Tangents, Parameters
divide_3 = DivideCurve(Curve=cir_4, Count=Slider(10, range=1..10), Kinks=False)  # -> Points, Tangents, Parameters
divide_4 = DivideCurve(Curve=cir_3, Count=Slider(10, range=1..10), Kinks=False)  # -> Points, Tangents, Parameters
pdecon = Deconstruct(Point=divide.Points)  # -> XComponent, YComponent, ZComponent
multiplication = Multiplication(A=pdecon.XComponent, B=Slider(2, range=1..10))
pt = ConstructPoint(XCoordinate=multiplication, YCoordinate=pdecon.YComponent, ZCoordinate=pdecon.ZComponent)
ln = Line(StartPoint=pt, EndPoint=divide_2.Points)
ln_2 = Line(StartPoint=divide_3.Points, EndPoint=divide_2.Points)
ln_3 = Line(StartPoint=divide_4.Points, EndPoint=pt)
join = JoinCurves(Curves=[ln_2, ln_3, ln], Preserve=False)
pipe = Pipe(Curve=join, Radius=Slider(0.5, range=0.5..10), Caps=0)
